# Grasshopper definition 1_Network grid generator.gh (Grasshopper 1.0.7)
# plug-ins: Urbano, Human

# ----
# https://boundingbox.klokantech.com/
# search for the area
# select CSV output
# copy and paste
bbox_left_bottom_right_top = Panel("2.052498,41.317035,2.228355,41.468252")

panel = Panel("""primary
secondary
tertiary
residential
pedestrian""")
cluster = Cluster(T=bbox_left_bottom_right_top, txt="highway", txt_2=panel)  # -> out_2, in_2, feat_2
panel_2 = Panel(cluster.in_2)
importosm = ImportOSMFeatures(OSMPathOrURL=panel_2, OSMFeatureType=cluster.feat_2, Format="xml", ImportAltitude=False)  # -> Points, Metadata, UTMZone, TranslationVector
pline = PolyLine(Vertices=importosm.Points, Closed=False)
bbox = BoundingBox(Content=flatten(pline), Plane=PlaneXY(0, 0, 0), UnionBox=True)  # -> Box, Box_2
debox = DeconstructBox(Box=bbox.Box)  # -> Plane, X, Y, Z
merge = Merge(Data1=debox.X, Data2=debox.Y)
panel_3 = Panel("highway")
demeta = DeconstructMetadata(Metadata=importosm.Metadata)  # -> Keys, Values
dedomain = DeconstructDomain(Domain=merge)  # -> Start, End
item = ListItem(List=dedomain.Start, Index=0, Wrap=True)  # -> Item, Item1
subtraction = Subtraction(A=dedomain.End, B=dedomain.Start)
mindex = MemberIndex(Set=demeta.Keys, Member=panel_3)  # -> Index, Count
pt = ConstructPoint(XCoordinate=item.Item, YCoordinate=item.Item1, ZCoordinate=0)
division = Division(A=subtraction, B="1800")
round = Round(Number=division)  # -> Nearest, Floor, Ceiling
item_2 = ListItem(List=demeta.Values, Index=mindex.Index, Wrap=True)  # -> flatten(Item)
multiplication = Multiplication(A=round.Nearest, B="2")
cset = CreateSet(List=item_2)  # -> Set, Map
item_3 = ListItem(List=multiplication, Index=0, Wrap=True)  # -> Item, Item1
mindex_2 = MemberIndex(Set=item_2, Member=cset.Set)  # -> Index, Count
trigrid = Triangular(Plane=pt, Size="1800", ExtentX=item_3.Item, ExtentY=item_3.Item1)  # -> Cells, Points
item_4 = ListItem(List=flatten(pline), Index=mindex_2.Index, Wrap=True)
disc = Discontinuity(Curve=trigrid.Cells, Level=1)  # -> Points, Parameters
lng = ListLength(List=cset.Set)
cullpt = CullDuplicates(Points=flatten(disc.Points), Tolerance=0.1, CullMode=1)  # -> Points, Indices, Valence
wheel = ColourWheel(
    lng,
    ColourGrips_Style=20,
    ColourGrips_Grip=[4.138211665, 0.9309193496, 4.188790205, 3.141592654],
    ColourGrips_Lum=[0.5767506523, 0.662257882],
    ColourGrips_Range=[0.908349306, 0.908349306, 0.908349306, 0.908349306],
    ColourGrips_Sat=[0.4304397155, 0.5445899567])

# ----
# Draw a boundary to clip the area
boundary_clip = Curve(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)

incurve = PointInCurve(Point=cullpt.Points, Curve=boundary_clip)  # -> Relationship, Point
cull = CullPattern(List=cullpt.Points, CullPattern=incurve.Relationship)
previewlw = CustomPreviewLineweights(Geometry=item_4, Shader=graft(wheel), Thickness=Slider(2, range=0..10), Absolute=False)

panel_4 = Panel("1000")  # disabled
cir = Circle(Plane=cull, Radius=panel_4)  # disabled

neg = Negative(Value=importosm.TranslationVector)
move = Move(Geometry=cull, Motion=neg)  # -> Geometry, Transform
projpt = ProjectGeographicPoint(Point=move.Geometry, Projection="UTM -> WSG84", UTMZone=importosm.UTMZone)  # -> Out, UTMZone
pdecon = Deconstruct(Point=projpt.Out)  # -> XComponent, YComponent, ZComponent
entwine = Entwine(Branch00=pdecon.YComponent, Branch01=pdecon.XComponent, FlattenInputs=True)
panel_5 = Panel("""lat
lng""")
ins = InsertItems(List=entwine, Item=graft(panel_5), Indices="0", Wrap=True)
flip = FlipMatrix(Data=ins)
join = TextJoin(Text=flip, Join=";")  # -> flatten(Result)

# ----
# right click
# stream destination in:
# 
# ./data/grid_locations.csv
# 
# make sure stream content is on
panel_6 = Panel(join)  # disabled

# ==== cluster Cluster
T = ClusterInput()
txt = ClusterInput()
txt_2 = ClusterInput()
txt_3 = ClusterInput()
txt_4 = Text(txt_2)
txt_5 = Text(txt_3)
txt_6 = Text(txt)
lng = ListLength(List=txt_6)
null = NullItem(Item=txt_4)  # -> NullFlags, InvalidFlags, Description
null_2 = NullItem(Item=txt_5)  # -> NullFlags, InvalidFlags, Description
equals = Equality(FirstNumber=lng, SecondNumber="1")  # -> Equality, Inequality
concat = Concatenate(FragmentD=" modv=\"not\"", FragmentA=" v=\"", FragmentB=txt_5, FragmentC="\"")
concat_2 = Concatenate(FragmentA=" v=\"", FragmentB=txt_4, FragmentC="\"")
ma = MassAddition(Input=null.NullFlags)  # -> Result, PartialResults
ma_2 = MassAddition(Input=null_2.NullFlags)  # -> Result, PartialResults
split = TextSplit(Text=T, Separators=",")
filter = StreamFilter(Gate=ma.Result, Stream0=concat_2)
filter_2 = StreamFilter(Gate=ma_2.Result, Stream0=concat)
item = ListItem(List=split, Index=0, Wrap=True)  # -> Item, Item1, Item2, Item3
panel = Panel("""node
way
relation""")
merge = Merge(Data1=item.Item1, Data2=item.Item, Data3=item.Item3, Data4=item.Item2)  # -> flatten(Result)
merge_2 = Merge(Data1=filter, Data2=filter_2)  # -> flatten(Result)
concat_3 = Concatenate(
    FragmentA="<query type=\"",
    FragmentB=panel,
    FragmentC="\"><has-kv k=\"",
    FragmentD=txt_6,
    FragmentE="\"",
    FragmentF=graft(merge_2),
    FragmentG="/></query>")
join = TextJoin(Text=merge, Join=",")
lng_2 = ListLength(List=merge)
equals_2 = Equality(FirstNumber="4", SecondNumber=lng_2)  # -> Equality, Inequality
join_2 = TextJoin(Text=concat_3)  # -> flatten(Result)
blank_line = Panel("")
join_3 = TextJoin(Text=join_2, Join=blank_line)
panel_2 = Panel("""<union>
<item/>
<recurse type="down"/>
</union>
<print mode="body"/>
</osm-script>""")
concat_4 = Concatenate(FragmentA="<union>", FragmentB=join_3, FragmentC="</union>")
concat_5 = Concatenate(FragmentA="<osm-script output=\"xml\" timeout=\"100\" bbox=\"", FragmentB=join, FragmentC="\">")
concat_6 = Concatenate(FragmentA=concat_5, FragmentD=concat_4, FragmentC=panel_2)
p_n_c = PickNChoose(Pattern=equals.Equality, Stream0="insert one and only key", Stream1=concat_6)
filter_3 = StreamFilter(Gate=equals_2.Equality, Stream1=p_n_c)
key = Text(txt)
replace = ReplaceMembers(Set=key, Find="highway", Replace="street")
concat_7 = Concatenate(FragmentA="http://overpass-api.de/api/interpreter?data=", FragmentB=filter_3)
out = Text(filter_3)
feat = Text(replace)
in = Text(concat_7)
out_2 = ClusterOutput(out)
in_2 = ClusterOutput(in)
feat_2 = ClusterOutput(feat)
