# Grasshopper definition 2_Mapping street services.gh (Grasshopper 1.0.7)
# plug-ins: Urbano, Human, Tarsier

# ----
# https://boundingbox.klokantech.com/
# search for the area
# select CSV output
# copy and paste
bbox_left_bottom_right_top = Panel("2.052498,41.317035,2.228355,41.468252")

# ----
# Link here to your places.csv file
path = FilePath("C:\Users\iacopo\Desktop\GSS21-Urban-Analytics-main\places - BCN - cat.csv")

panel = Panel("""primary
secondary
tertiary
residential
pedestrian""")
cluster = Cluster(T=bbox_left_bottom_right_top, txt="highway", txt_2=panel)  # -> out_2, in_2, feat_2
panel_2 = Panel(cluster.in_2)
importosm = ImportOSMFeatures(OSMPathOrURL=panel_2, OSMFeatureType=cluster.feat_2, Format="xml", ImportAltitude=False)  # -> Points, Metadata, UTMZone, TranslationVector
file = ReadFile(File=path, PerLineParse=True)
pline = PolyLine(Vertices=importosm.Points, Closed=False)
utm = Data(importosm.UTMZone)
vec = Data(importosm.TranslationVector)
split = TextSplit(Text=file, Separators=";")  # -> simplify(Result)
path_2 = ConstructPath(Indices=Slider(0, range=0..100))
panel_3 = Panel("highway")
demeta = DeconstructMetadata(Metadata=importosm.Metadata)  # -> Keys, Values
split_2 = SplitTree(Data=split, Masks=flatten(path_2))  # -> Positive, Negative
mindex = MemberIndex(Set=demeta.Keys, Member=panel_3)  # -> Index, Count
panel_4 = Panel(split_2.Positive)
item = ListItem(List=split_2.Negative, Index="3", Wrap=True)  # -> Item, Item1
item_2 = ListItem(List=split_2.Negative, Index="2", Wrap=True)  # -> flatten(Item)
panel_5 = Panel(panel)
item_3 = ListItem(List=demeta.Values, Index=mindex.Index, Wrap=True)  # -> flatten(Item)
pt = ConstructPoint(XCoordinate=item.Item1, YCoordinate=item.Item, ZCoordinate=0)  # -> flatten(Point)
rev = ReverseList(List=panel_5)
panel_6 = Panel(rev)
projpt = ProjectGeographicPoint(Point=pt, Projection="WSG84 -> UTM", UTMZone=utm)  # -> Out, UTMZone
mindex_2 = MemberIndex(Set=item_3, Member=panel_6)  # -> Index, Count
lng = ListLength(List=panel_6)
move = Move(Geometry=projpt.Out, Motion=vec)  # -> Geometry, Transform
item_4 = ListItem(List=flatten(pline), Index=mindex_2.Index, Wrap=True)
series = Series(Start="1", Step=1, Count=lng)
previewlw = CustomPreviewLineweights(Geometry=item_4, Shader=graft(ColourSwatch(SwatchColor=RGB(56, 56, 56))), Thickness=graft(series), Absolute=False)
graft = GraftTree(Tree=item_4, IncludeEmptyLists=True, IncludeNullItems=True)
divlength = DivideLength(Curve=graft, Length=Slider(50, range=0..100))  # -> Points, Tangents, Parameters
lng_2 = ListLength(List=divlength.Points)
construct = ConstructPointCloud(Points=move.Geometry)
divide = DivideCurve(Curve=graft, Count=lng_2, Kinks=False)  # -> Points, Tangents, Parameters
flatten = FlattenTree(Tree=divide.Points, Path="{0}")
kdconstruct = ConstructKDTree(PointCloud=construct)
preview = PreviewPointCloud(PointCloud=construct, Weight=Slider(7, range=0..10))
cir = Circle(Plane=flatten, Radius="60")
kdsample = SampleKDTree(KDTree=kdconstruct, Points=flatten, Range="60", MaximumPointsReturned=1024)  # -> simplify(Indices)
item_5 = ListItem(List=item_2, Index=kdsample, Wrap=True)
panel_7 = Panel("""NEED
LEISURE
CULTURE""")
mindex_3 = MemberIndex(Set=item_5, Member=panel_7)  # -> Index, Count
panel_8 = Panel(panel_6)
trim = TrimTree(Tree=simplify(divide.Points), Depth=1)
ma = MassAddition(Input=mindex_3.Count)  # -> flatten(Result), PartialResults
tstat = TreeStatistics(Tree=trim)  # -> Paths, Length, Count
sort = SortList(Keys=mindex_3.Count, ValuesB=panel_7)  # -> reverse(Keys), reverse(ValuesB)
repeat = RepeatData(Data=graft(panel_8), Length=graft(tstat.Length))  # -> flatten(Data)
item_6 = ListItem(List=sort.ValuesB, Index=0, Wrap=True)  # -> flatten(Item)
entwine = Entwine(Branch00=repeat, Branch01=ma.Result, Branch02=item_6, FlattenInputs=True)
utm_2 = Data(utm)
vec_2 = Data(vec)

number_of_amenities = Data(ma.Result)
street_typology = Data(repeat)
street_points = Data(flatten)
amenities = Data(mindex_3.Count)
remap = RemapNumbers(Value=number_of_amenities, Source=Slider(100, range=0..200), Target=Slider(60, range=0..100))  # -> Mapped, Clipped
panel_9 = Panel(panel_6)
merge = Merge(
    Data1=ColourSwatch(SwatchColor=RGB(65, 101, 242)),
    Data2=ColourSwatch(SwatchColor=RGB(163, 242, 65)),
    Data3=ColourSwatch(SwatchColor=RGB(242, 65, 65)))
cir_2 = Circle(Plane=street_points, Radius=remap.Mapped)
sort_2 = SortList(Keys=amenities, ValuesB=merge)  # -> reverse(Keys), reverse(ValuesB)
item_7 = ListItem(List=panel_9, Index=Slider(0, range=0..4), Wrap=True)
item_8 = ListItem(List=sort_2.ValuesB, Index=0, Wrap=True)  # -> flatten(Item)
mindex_4 = MemberIndex(Set=street_typology, Member=item_7)  # -> Index, Count
panel_10 = Panel(item_7)
item_9 = ListItem(List=cir_2, Index=mindex_4.Index, Wrap=True)
item_10 = ListItem(List=item_8, Index=mindex_4.Index, Wrap=True)
previewlw_2 = CustomPreviewLineweights(Geometry=item_9, Shader=item_10, Thickness=Slider(2, range=0..10), Absolute=False)

neg = Negative(Value=vec_2)
move_2 = Move(Geometry=flatten, Motion=neg)  # -> Geometry, Transform
projpt_2 = ProjectGeographicPoint(Point=move_2.Geometry, Projection="UTM -> WSG84", UTMZone=utm_2)  # -> Out, UTMZone
pdecon = Deconstruct(Point=projpt_2.Out)  # -> XComponent, YComponent, ZComponent
entwine_2 = Entwine(Branch00=pdecon.YComponent, Branch01=pdecon.XComponent, FlattenInputs=True)
entwine_3 = Entwine(Branch0X=entwine_2, Branch1X=entwine, FlattenInputs=False)
columns_name = Panel("""lat
lng
STREET TYPOLOGY
NUMBER OF AMENITIES
MAIN CATEGORY""")
lng_3 = ListLength(List=columns_name)  # disabled
panel_11 = Panel("0")  # disabled
ins = InsertItems(List=entwine_3, Item=graft(columns_name), Indices=panel_11, Wrap=True)  # -> simplify(List); disabled
series_2 = Series(Start=0, Step=1, Count=graft(lng_3))  # -> graft(Series); disabled
match = MatchTree(Tree=ins, Guide=series_2)  # disabled
flip = FlipMatrix(Data=match)  # disabled
panel_12 = Panel(";")  # disabled
join = TextJoin(Text=flip, Join=panel_12)  # -> flatten(Result); disabled

# ----
# right click
# stream destination in:
# 
# ./output/map.csv
# 
# make sure stream content is on
panel_13 = Panel(join)  # disabled

# ==== cluster Cluster
T = ClusterInput()
txt = ClusterInput()
txt_2 = ClusterInput()
txt_3 = ClusterInput()
txt_4 = Text(txt_2)
txt_5 = Text(txt_3)
txt_6 = Text(txt)
lng = ListLength(List=txt_6)
null = NullItem(Item=txt_4)  # -> NullFlags, InvalidFlags, Description
null_2 = NullItem(Item=txt_5)  # -> NullFlags, InvalidFlags, Description
equals = Equality(FirstNumber=lng, SecondNumber="1")  # -> Equality, Inequality
concat = Concatenate(FragmentD=" modv=\"not\"", FragmentA=" v=\"", FragmentB=txt_5, FragmentC="\"")
concat_2 = Concatenate(FragmentA=" v=\"", FragmentB=txt_4, FragmentC="\"")
ma = MassAddition(Input=null.NullFlags)  # -> Result, PartialResults
ma_2 = MassAddition(Input=null_2.NullFlags)  # -> Result, PartialResults
split = TextSplit(Text=T, Separators=",")
filter = StreamFilter(Gate=ma.Result, Stream0=concat_2)
filter_2 = StreamFilter(Gate=ma_2.Result, Stream0=concat)
item = ListItem(List=split, Index=0, Wrap=True)  # -> Item, Item1, Item2, Item3
panel = Panel("""node
way
relation""")
merge = Merge(Data1=item.Item1, Data2=item.Item, Data3=item.Item3, Data4=item.Item2)  # -> flatten(Result)
merge_2 = Merge(Data1=filter, Data2=filter_2)  # -> flatten(Result)
concat_3 = Concatenate(
    FragmentA="<query type=\"",
    FragmentB=panel,
    FragmentC="\"><has-kv k=\"",
    FragmentD=txt_6,
    FragmentE="\"",
    FragmentF=graft(merge_2),
    FragmentG="/></query>")
join = TextJoin(Text=merge, Join=",")
lng_2 = ListLength(List=merge)
equals_2 = Equality(FirstNumber="4", SecondNumber=lng_2)  # -> Equality, Inequality
join_2 = TextJoin(Text=concat_3)  # -> flatten(Result)
blank_line = Panel("")
join_3 = TextJoin(Text=join_2, Join=blank_line)
panel_2 = Panel("""<union>
<item/>
<recurse type="down"/>
</union>
<print mode="body"/>
</osm-script>""")
concat_4 = Concatenate(FragmentA="<union>", FragmentB=join_3, FragmentC="</union>")
concat_5 = Concatenate(FragmentA="<osm-script output=\"xml\" timeout=\"100\" bbox=\"", FragmentB=join, FragmentC="\">")
concat_6 = Concatenate(FragmentA=concat_5, FragmentD=concat_4, FragmentC=panel_2)
p_n_c = PickNChoose(Pattern=equals.Equality, Stream0="insert one and only key", Stream1=concat_6)
filter_3 = StreamFilter(Gate=equals_2.Equality, Stream1=p_n_c)
key = Text(txt)
replace = ReplaceMembers(Set=key, Find="highway", Replace="street")
concat_7 = Concatenate(FragmentA="http://overpass-api.de/api/interpreter?data=", FragmentB=filter_3)
out = Text(filter_3)
feat = Text(replace)
in = Text(concat_7)
out_2 = ClusterOutput(out)
in_2 = ClusterOutput(in)
feat_2 = ClusterOutput(feat)
