# Grasshopper definition Network_generator.gh (Grasshopper 1.0.7)
# plug-ins: Urbano, Human

# ----
# https://boundingbox.klokantech.com/
# search for the area
# select CSV output
# copy and paste
bbox_left_bottom_right_top = Panel("9.040887,45.386738,9.27811,45.535848")

panel = Panel("""primary
tertiary
secondary
residential""")
cluster = Cluster(T=bbox_left_bottom_right_top, txt="highway", txt_2=panel)
panel_2 = Panel(cluster)
importosm = ImportOSMFeatures(OSMPathOrURL=panel_2, OSMFeatureType="street", Format="xml", ImportAltitude=False)  # -> Points, Metadata, UTMZone, TranslationVector
pline = PolyLine(Vertices=importosm.Points, Closed=False)
bbox = BoundingBox(Content=flatten(pline), Plane=PlaneXY(0, 0, 0), UnionBox=True)  # -> Box, Box_2
debox = DeconstructBox(Box=bbox.Box)  # -> Plane, X, Y, Z
merge = Merge(Data1=debox.X, Data2=debox.Y)
demeta = DeconstructMetadata(Metadata=importosm.Metadata)  # -> Keys, Values
dedomain = DeconstructDomain(Domain=merge)  # -> Start, End
item = ListItem(List=dedomain.Start, Index=0, Wrap=True)  # -> Item, Item1
subtraction = Subtraction(A=dedomain.End, B=dedomain.Start)
mindex = MemberIndex(Set=demeta.Keys, Member="highway")  # -> Index, Count
pt = ConstructPoint(XCoordinate=item.Item, YCoordinate=item.Item1, ZCoordinate=0)
division = Division(A=subtraction, B="1800")
round = Round(Number=division)  # -> Nearest, Floor, Ceiling
item_2 = ListItem(List=demeta.Values, Index=mindex.Index, Wrap=True)  # -> flatten(Item)
multiplication = Multiplication(A=round.Nearest, B="2")
cset = CreateSet(List=item_2)  # -> Set, Map
item_3 = ListItem(List=multiplication, Index=0, Wrap=True)  # -> Item, Item1
mindex_2 = MemberIndex(Set=item_2, Member=cset.Set)  # -> Index, Count
trigrid = Triangular(Plane=pt, Size="1800", ExtentX=item_3.Item, ExtentY=item_3.Item1)  # -> Cells, Points
item_4 = ListItem(List=flatten(pline), Index=mindex_2.Index, Wrap=True)
disc = Discontinuity(Curve=trigrid.Cells, Level=1)  # -> Points, Parameters
lng = ListLength(List=cset.Set)
cullpt = CullDuplicates(Points=flatten(disc.Points), Tolerance=0.1, CullMode=1)  # -> Points, Indices, Valence
wheel = ColourWheel(
    lng,
    ColourGrips_Style=20,
    ColourGrips_Grip=[4.138211665, 0.9309193496, 4.188790205, 3.141592654],
    ColourGrips_Lum=[0.5767506523, 0.662257882],
    ColourGrips_Range=[0.908349306, 0.908349306, 0.908349306, 0.908349306],
    ColourGrips_Sat=[0.4304397155, 0.5445899567])

# ----
# Draw a boundary to clip the area
boundary_clip = Curve()

incurve = PointInCurve(Point=cullpt.Points, Curve=boundary_clip)  # -> Relationship, Point
cull = CullPattern(List=cullpt.Points, CullPattern=incurve.Relationship)
previewlw = CustomPreviewLineweights(Geometry=item_4, Shader=graft(wheel), Thickness=Slider(2, range=0..10), Absolute=False)
neg = Negative(Value=importosm.TranslationVector)
cir = Circle(Plane=cull, Radius="1000")
move = Move(Geometry=cull, Motion=neg)  # -> Geometry, Transform
projpt = ProjectGeographicPoint(Point=move.Geometry, Projection="UTM -> WSG84", UTMZone=importosm.UTMZone)  # -> Out, UTMZone
pdecon = Deconstruct(Point=projpt.Out)  # -> XComponent, YComponent, ZComponent
entwine = Entwine(Branch00=pdecon.YComponent, Branch01=pdecon.XComponent, FlattenInputs=True)
panel_3 = Panel("""lat
lng""")
ins = InsertItems(List=entwine, Item=graft(panel_3), Indices="0", Wrap=True)
flip = FlipMatrix(Data=ins)
join = TextJoin(Text=flip, Join=";")  # -> flatten(Result)

# ----
# right click
# stream destination in:
# 
# ./data/grid_locations.csv
# 
# make sure stream content is on
panel_4 = Panel(join)

# ==== cluster Cluster
T = ClusterInput()
txt = ClusterInput()
txt_2 = ClusterInput()
txt_3 = ClusterInput()
txt_4 = Text(txt_2)
txt_5 = Text(txt_3)
txt_6 = Text(txt)
lng = ListLength(List=txt_6)
equals = Equality(FirstNumber=lng, SecondNumber="1")  # -> Equality, Inequality
concat = Concatenate(FragmentD=" modv=\"not\"", FragmentA=" v=\"", FragmentB=txt_5, FragmentC="\"")
concat_2 = Concatenate(FragmentA=" v=\"", FragmentB=txt_4, FragmentC="\"")
null = NullItem(Item=txt_4)  # -> NullFlags, InvalidFlags, Description
null_2 = NullItem(Item=txt_5)  # -> NullFlags, InvalidFlags, Description
split = TextSplit(Text=T, Separators=",")
filter = StreamFilter(Gate=null.NullFlags, Stream0=concat_2)
filter_2 = StreamFilter(Gate=null_2.NullFlags, Stream0=concat)
item = ListItem(List=split, Index=0, Wrap=True)  # -> Item, Item1, Item2, Item3
panel = Panel("""node
way
relation""")
merge = Merge(Data1=item.Item1, Data2=item.Item, Data3=item.Item3, Data4=item.Item2)  # -> flatten(Result)
merge_2 = Merge(Data1=filter, Data2=filter_2)  # -> flatten(Result)
concat_3 = Concatenate(
    FragmentA="<query type=\"",
    FragmentB=panel,
    FragmentC="\"><has-kv k=\"",
    FragmentD=txt_6,
    FragmentE="\"",
    FragmentF=graft(merge_2),
    FragmentG="/></query>")
join = TextJoin(Text=merge, Join=",")
lng_2 = ListLength(List=merge)
equals_2 = Equality(FirstNumber="4", SecondNumber=lng_2)  # -> Equality, Inequality
join_2 = TextJoin(Text=concat_3)  # -> flatten(Result)
panel_2 = Panel("""http://overpass-api.de/api/interpreter?data=
<osm-script output="xml" timeout="100" bbox="
""")
blank_line = Panel("")
join_3 = TextJoin(Text=join_2, Join=blank_line)
panel_3 = Panel("""<union>
<item/>
<recurse type="down"/>
</union>
<print mode="body"/>
</osm-script>""")
concat_4 = Concatenate(FragmentA="<union>", FragmentB=join_3, FragmentC="</union>")
concat_5 = Concatenate(FragmentA=panel_2, FragmentB=join, FragmentC="\">")
concat_6 = Concatenate(FragmentA=concat_5, FragmentD=concat_4, FragmentC=panel_3)
p_n_c = PickNChoose(Pattern=equals.Equality, Stream0="insert one and only key", Stream1=concat_6)
filter_3 = StreamFilter(Gate=equals_2.Equality, Stream1=p_n_c)
txt_7 = Text(filter_3)
txt_8 = ClusterOutput(txt_7)
